# Grasshopper definition Assignment1_WIP.gh (Grasshopper 1.0.7)

datapath = FilePath("C:\Users\hanifu\Documents\04. Computational Design\00. ASSIGNMENTS\1. Local-Global\Moon Topography res.jpg")
proto_landscape = CSharpScript(imageFile=datapath, sizeX=Slider(80, range=0..80), sizeY=Slider(80, range=0..80), maxHeight=Slider(30, range=0..30))  # -> out, S, V, RY, RX, SIZEX, SIZEY, MESH, CMESH; inputs imageFile: String, sizeX: Double, sizeY: Double, maxHeight: Double
# ---------- proto_landscape: C# ----------
    //................................load image
    System.Drawing.Bitmap mybmp = new System.Drawing.Bitmap(imageFile);

    //................................image resolution
    int rx = mybmp.Width;
    int ry = mybmp.Height;

    //................................calculate real world grid step
    double dx = sizeX / (double) (rx - 1.0);
    double dy = sizeY / (double) (ry - 1.0);

    //.................................intialize storage lists

    List<double> s = new List<double>();
    List<Vector3d> v = new List<Vector3d>();
    List<System.Drawing.Color> colors = new List<System.Drawing.Color>();

    //.....................................elevation values



    for(int j = ry - 1; j >= 0; --j) {
      for (int i = 0; i < rx; ++i) {
        System.Drawing.Color c = mybmp.GetPixel(i, j);
        double elevation = c.GetBrightness() * maxHeight;
        s.Add(elevation);
        colors.Add(c);
      }
    }

    //.......................................gradient

    Mesh mesh = new Mesh();
    Mesh cmesh = new Mesh();

    int k = 0;
    for(int j = 0; j < ry; ++j) {
      for (int i = 0; i < rx; ++i) {

        mesh.Vertices.Add(i * dx, j * dy, s[k]);
        cmesh.Vertices.Add(i * dx, j * dy, 0.0);
        cmesh.VertexColors.Add(colors[k]);

        double dsx = 0.0;
        double dsy = 0.0;



        if (i == 0) {
          dsx = (s[k + 1] - s[k]);
        }
        else if (i == rx - 1) {
          dsx = (s[k] - s[k - 1]);
        }
        else {
          dsx = (s[k + 1] - s[k - 1]);
        }

        if (j == 0) {
          dsy = (s[k + rx] - s[k]);
        }
        else if (j == ry - 1) {
          dsy = (s[k] - s[k - rx]);
        }
        else {
          dsy = (s[k + rx] - s[k - rx]);
        }


        Vector3d g = new Vector3d(-2.0 * dsx * dy, -2.0 * dsy * dx, 4.0 * dx * dy);
        g.Unitize();
        v.Add(g);

        ++k;
      }
    }

    for(int j = 0; j < ry - 1; ++j) {
      for (int i = 0; i < rx - 1; ++i) {
        k = j * rx + i;
        mesh.Faces.AddFace(k, k + 1, k + 1 + rx, k + rx);
        cmesh.Faces.AddFace(k, k + 1, k + 1 + rx, k + rx);
      }
    }

    mesh.Normals.ComputeNormals();

    //...............................outputs

    S = s;
    V = v;
    RX = rx;
    RY = ry;
    SIZEX = sizeX;
    SIZEY = sizeY;
    MESH = mesh;
    CMESH = cmesh;
# ---------- end proto_landscape ----------
preview = CustomPreview(Geometry=proto_landscape.MESH, Material=ColourSwatch(SwatchColor=RGBA(230, 140, 0, 120)))

sort_list = SortList(Keys=proto_landscape.S)  # -> Keys, ValuesA
panel = Panel(sort_list.Keys)

pt = Point(<point referenced from the Rhino model>)
c_start_component = CSharpScript(
    s=proto_landscape.S,
    v=proto_landscape.V,
    ry=proto_landscape.RY,
    rx=proto_landscape.RX,
    sizeX=proto_landscape.SIZEX,
    sizeY=proto_landscape.SIZEY,
    focus=pt)  # -> out, A, B; inputs s: list of Double, v: list of Vector3d, ry: Int32, rx: Int32, sizeX: Double, sizeY: Double, focus: Point3d
# ---------- c_start_component: C# ----------
    //START GLOBAL 0
    
    //creater an empty list to add the lines for the output
    List<Line> lines = new List<Line>();
    
    //create an empty list of vectors for the focus point
    List<Vector3d> vectors = new List<Vector3d>();
    
    //create an empty list of point to put the local components
    List<Point3d> points = new List<Point3d>();
    
    //END GLOBAL 0
    
    //compute steps of grid so that we can calculate the physical locations of points from the row/column indices
    double dx = sizeX / (double) (rx - 1.0);
    double dy = sizeY / (double) (ry - 1.0);

    //start looping through all possible index pairs in the grid ry x rx
    for (int j = 0; j < ry; ++j) {
      for(int i = 0; i < rx; ++i) {
        Point3d p = new Point3d(i * dx, j * dy, 0.0); //compute the physical point location on the XY plane
        int k = j * rx + i;                           //compute the serial index so that we can pickup values from the lists s and v

        
        //START GLOBAL1
        
        //Set up focus point to vector
        Vector3d toFocus = focus - p;
        toFocus.Unitize();
        
        //Set a limit to the vector length
        toFocus *= 1.50;
        
        //Connecting the focus point to vector list
        vectors.Add(toFocus);
        
        //Populate the points with connected vector
        points.Add(p + toFocus);

        //END GLOBAL1
        
        //GLOBAL 2
        
        //Set up a modulo for the grid so it doesn't get too crowded
        //Populate the valley only (valley means it has slope value below 10)
        if (i % 3 == 0 && s[k] < 10 ) 
        
        //GLOBAL 2
          
        { 
          
          //call the makeComponent method from below to get hold of the local wireframe geometry
          List<Line> component = makeComponent(p, s[k], vectors[k], focus); 
          lines.AddRange(component);
        
        }

      }
    }
    
    
    A = lines;
# ---------- c_start_component: C# additional code ----------
  List<Line> makeComponent(Point3d p, double s, Vector3d v, Point3d focus) {
    List<Line> lines = new List<Line>();

    Point3d elevatedPoint = p;
    elevatedPoint.Z = s;

    Vector3d toFocus = focus - p;
    toFocus.Unitize();

    double height = toFocus.Length;

    // + v * 3 / s = makes longer lines at the lower s. Adjust the 3 value according to shapes
    lines.Add(new Line(elevatedPoint, elevatedPoint + v * 3 / s));

    //END LOCAL

    return lines;
  }
# ---------- end c_start_component ----------

panel_2 = Panel(proto_landscape.V)
panel_3 = Panel(c_start_component.B)
